# Grasshopper definition example_01.gh (Grasshopper 1.0.7)
# plug-ins: Kangaroo2 Components

panel = Panel("""3.5355339059327373
6
2.5""")
line = Line([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])
length = Length(0)
anchor = Anchor(Point=[Point(-1, 1, 0), Point(1, 0, 0), Point(0, 2, 0)], Strength="10000")
length_line = LengthLine(Line=line, Length=length, Strength=panel)
solver = Solver(GoalObjects=[length_line, anchor], Reset=Button(), Threshold=1e-15, Tolerance=0.0001, On=True)  # -> I, V, O
fullprecision = GhPythonScript(x=solver.V)  # -> out
# ---------- fullprecision: Python ----------
__author__ = "Thomas Oberbichler"

from Rhino.Geometry import *

print(x)
# ---------- end fullprecision ----------
panel_2 = Panel(fullprecision)
